# Grasshopper definition Components bookWorm.gh (Grasshopper 1.0.7)
# plug-ins: Bookworm

toggle = BooleanToggle(True)
toggle_2 = BooleanToggle(True)
toggle_3 = BooleanToggle(True)
swatch = ColourSwatch(SwatchColor=RGB(196, 0, 255))
concellborder = ConstructCellBorder(BorderStyle="2", Color=ColourSwatch(SwatchColor=RGB(255, 242, 0)))
concellborder_2 = ConstructCellBorder(BorderStyle="5", Color=ColourSwatch(SwatchColor=RGB(255, 149, 0)))
connumberformat = ConstructNumberFormat(NumberFormatType="5")
connumberformat_2 = ConstructNumberFormat()
contextformat = ConstructTextFormat(
    ForegroundColor=swatch,
    FontFamily="Verdana",
    FontSize=Slider(15, range=0..100),
    Bold=toggle_2,
    Italic=Toggle(False),
    Strikethrought=toggle_2,
    Underline=toggle_2)
panel = Panel(ColourSwatch(SwatchColor=RGB(242, 205, 94)))
contextrotation = ConstructTextRotation(Angle=Slider(60, range=-90..90))
panel_2 = Panel(swatch)
conpadding = ConstructPadding(Top="50", Bottom="20", Left=0, Right=0)
concellborders = ConstructCellBorders(BorderTop=concellborder, BorderBottom=concellborder_2, BorderLeft=concellborder_2, BorderRight=concellborder)
panel_3 = Panel(concellborders)
swatch_2 = ColourSwatch(SwatchColor=RGB(146, 189, 4))
panel_4 = Panel(swatch_2)
panel_5 = Panel(connumberformat)
panel_6 = Panel(contextformat)
panel_7 = Panel(contextrotation)
panel_8 = Panel(conpadding)

number_slider = Slider(2, range=0..10)
number_slider_2 = Slider(0, range=0..10)
number_slider_3 = Slider(3, range=0..10)
number_slider_4 = Slider(1, range=0..10)

number_slider_5 = Slider(500, range=0..1000)
panel_9 = Panel("""Количество комнат
Евро
Студия""")
conextendedvalue = ConstructExtendedValue(Value=panel_9)
concellformat = ConstructCellFormat(
    NumberFormat=connumberformat_2,
    BackgroundColor=swatch_2,
    Borders=concellborders,
    Padding=conpadding,
    TextFormat=contextformat,
    TextRotation=contextrotation)
panel_10 = Panel("1A4-OZONXYfRZbBfHRNpN6nU8IgeaBQi29x4bGgja-Aw")
panel_11 = Panel(concellformat)
concell = ConstructCell(UserEnteredValue=conextendedvalue, CellFormat=concellformat)
merge = Merge(Data1=concell, Data2=concell)
readcellvalue = ReadCellValue(SpreadsheetURL=panel_10, SheetName="ns gbkjh", CellRange="b:c", Read=Toggle(True), SameLength=Toggle(False))
readcell = ReadCell(
    SpreadsheetURL=panel_10,
    SheetName="ns gbkjh",
    CellRange="b:c",
    DuplicateMerged=Toggle(True),
    SameLength=False,
    Read=Toggle(True))
readcell_2 = ReadCell(SheetName="Квартирография_1", CellRange="A1:B2", Read=Toggle(True), SameLength=False, Read_2=False)  # disabled
panel_12 = Panel(readcell)
panel_13 = Panel(readcellvalue)
decell = DeconstructCell(Cell=readcell_2)  # -> FormattedValue, UserEnteredValue, CellFormat
decell_2 = DeconstructCell(Cell=readcell)  # -> FormattedValue, UserEnteredValue, CellFormat

# ---- group: Write Cell Value
panel_14 = Panel("""228
true
14+88,00
of Van
=F2""")
writecellvalues = WriteCellValues(
    SpreadsheetURL="1A4-OZONXYfRZbBfHRNpN6nU8IgeaBQi29x4bGgja-Aw",
    SheetName="Лист1",
    CellRange="h:i",
    Values=panel_14,
    Append=Toggle(False),
    Run=Toggle(False))

# ----
concell_2 = ConstructCell(UserEnteredValue=decell.UserEnteredValue, CellFormat=decell.CellFormat)  # -> flatten(Cell)

# ---- group: write cells
panel_15 = Panel("1A4-OZONXYfRZbBfHRNpN6nU8IgeaBQi29x4bGgja-Aw")
writecell = WriteCells(SpreadsheetURL=panel_15, SheetName="Квартирография_1", CellRange="J1:J4", Cells=concell, Run=Button())

writecell_2 = WriteCells(SpreadsheetURL=panel_15, SheetName="brandnew", CellRange="18:19", Cells=merge, Run=Toggle(False))

# ---- group: merge cells
panel_16 = Panel("Лист1")
panel_17 = Panel("""a1:C2
15:16
J11:K13""")
panel_18 = Panel("""1
0
2""")
nickname = MergeCells(SpreadsheetURL=panel_15, SheetName=panel_16, CellRanges=panel_17, MergeTypes=panel_18, Run=Toggle(False))

# ---- group: unmerge cells
nickname_2 = UnmergeCells(SpreadsheetURL=panel_15, SheetName=panel_16, CellRanges=panel_17, Run=Toggle(False))

# ----
concell_3 = ConstructCell(UserEnteredValue=decell_2.UserEnteredValue, CellFormat=decell_2.CellFormat)  # -> flatten(Cell)
cull_i = CullIndex(List=concell_2, Indices="3", Wrap=True)
panel_19 = Panel(decell_2.CellFormat)
panel_20 = Panel(decell_2.FormattedValue)
panel_21 = Panel(decell_2.UserEnteredValue)
item = ListItem(List=cull_i, Index=0, Wrap=True)
merge_2 = Merge(Data1=cull_i, Data2=item)  # -> flatten(Result)
panel_22 = Panel(writecellvalues)
item_2 = ListItem(List=merge_2, Index="2", Wrap=True)
panel_23 = Panel(merge_2)
