# Grasshopper definition write_test_01.gh (Grasshopper 1.0.7)
# plug-ins: Bookworm

panel = Panel("""Oh my God!
It Works!""")
writecell = WriteCellRange(
    SpreadsheetId="189ivxpQlX0liyjyUpZQuqZTJNz12dlLsAD8eIfFqsVE",
    SheetName="Лист1",
    CellRange="C10",
    Values=panel,
    Append=Toggle(True),
    Write=Toggle(True))
